# Grasshopper definition Koala_Example.gh (Grasshopper 1.0.7)
# plug-ins: Koala

number_slider = Slider(31000, range=0..100000)

# ---- group: Number of initial planes
number_slider_2 = Slider(160, range=0..200)

# ----
pt = ConstructPoint(XCoordinate=0, YCoordinate=0, ZCoordinate=0)
pt_2 = ConstructPoint(XCoordinate=number_slider, YCoordinate=number_slider, ZCoordinate=Slider(24000, range=0..100000))
number_slider_3 = Slider(6, range=0..10)
box = Box2Pt(PointA=pt, PointB=pt_2, Plane=PlaneXY(0, 0, 0))

# ---- group: Create planes from list of 3 randomly selected points
number_slider_4 = Slider(140, range=0..1000)
number_slider_5 = Slider(690, range=0..1000)
subtraction = Subtraction(A=number_slider_2, B=Slider(3, range=0..10))
random = Random(Range=Domain(0, 1000), Number=number_slider_2, Seed=number_slider_4)
pop3d = Populate3D(Region=box, Count=number_slider_2, Seed=number_slider_5)
reduce = RandomReduce(List=pop3d, Reduction=subtraction, Seed=random)  # -> simplify(List)
plfit = PlaneFit(Points=reduce)  # -> Plane, Deviation

# ----
division = Division(A=number_slider, B=number_slider_3)
series = Series(Start=0, Step=division, Count=number_slider_3)
galapagos = Galapagos(fitness=hello, gene=[number_slider_4, number_slider_5])

# ---- group: Regular planes
series_2 = Series(Start=0, Step=1, Count=number_slider_3)
series_3 = Series(Start=number_slider_3, Step=1, Count=number_slider_3)
xz = XZPlane(Origin=Point(0, 0, 0))
Y = UnitY(Factor=series)
yz = YZPlane(Origin=Point(0, 0, 0))
X = UnitX(Factor=series)
dup = DuplicateData(Data=series_2, Number=number_slider_3, Order=False)
dup_2 = DuplicateData(Data=series_3, Number=number_slider_3, Order=True)
move = Move(Geometry=xz, Motion=Y)  # -> Geometry, Transform
move_2 = Move(Geometry=yz, Motion=X)  # -> Geometry, Transform
merge = Merge(Data1=graft(dup), Data2=graft(dup_2))  # -> simplify(Result)
merge_2 = Merge(Data1=move.Geometry, Data2=move_2.Geometry)

# ---- group: Number of planes to consider intersection for each plane
number_slider_6 = Slider(2, range=0..10)

# ----
panel = Panel(merge)

# ---- group: List of planes
flatten = FlattenTree(Tree=plfit.Plane, Path="{0}")

# ---- group: Create a tree structure(nested list)
# It allows to define
# which planes should intersect with which plane.
# It can be regular(between XZ planes and YZ planes)
# or can be randomly chosen from list of planes
# 
# 
# for j in range(1, len(Tree_of_planes[i])):
# //Get intersecting lines between:
#     Tree_of_planes[i][0] and Tree_of_planes[i][j]
python = GhPythonScript(max=number_slider_2, each=number_slider_6)  # -> out, simplify(indices); inputs max: Int32, each: Int32
# ---------- python: Python ----------
__author__ = "haruna"
__version__ = "2018.11.07"

import rhinoscriptsyntax as rs
import ghpythonlib.treehelpers as tr
import random

indices = []
num_list = []
for i in range(max):
    num_list.append(i)
for i in range(max):
    tmp = sorted(random.sample(num_list, each))
    indices.append(tmp)
b_set = set(map(tuple,indices))  #need to convert the inner lists to tuples so they are hashable
indices = map(list,b_set)

indices = tr.list_to_tree(indices)
# ---------- end python ----------

# ----
bnd = Bounds(Numbers=flatten(python.indices))
number_slider_7 = Slider(10000, range=0..10000)
timer = Timer(TimerInterval=20, Target=hello)
rad = Radians(Degrees=Slider(25, range=0..100))
hello = Koala(
    BoundingBox=box,
    Planes=flatten,
    Indices=python.indices,
    BucklingLength=number_slider_7,
    MinimumAngle=Slider(20, range=0..100),
    MinimumDistance=Slider(1000, range=0..1000),
    Continue=Toggle(False),
    Reset=Button(),
    MaxTranslation=Slider(1000, range=0..10000),
    MaxRotation=rad)  # -> Lines, Segments, Points, Fitness, Planes, Angles, BestLines
wires = BrepWireframe(Brep=box, Density=-1)
line = Line(hello.Lines)
line_2 = Line(hello.Segments)
pt_3 = Point(hello.Points)
pln = Plane(hello.Planes)

# ---- group: To visualize planes
pxs = PlaneThroughShape(Plane=pln, Shape=box, Inflate=1, SectionLogic=False)

# ----
rad_2 = Radians(Degrees=hello.Angles)
line_3 = Line(hello.BestLines)
shift = ShiftList(List=pt_3, Shift=1, Wrap=False)
panel_2 = Panel(hello.Angles)
short = ShortestList(ListA=pt_3, ListB=shift, TrimMode=2)  # -> ListA, ListB
rec = DataRecorder(hello.Fitness, DataLimit=-10, RecordData=False)
ln = Line(StartPoint=short.ListA, EndPoint=short.ListB)
graph = QuickGraph(rec, SortOrder=0)
bnd_2 = Bounds(Numbers=flatten(ln))
len = Length(Curve=ln)
smaller = SmallerThan(FirstNumber=len, SecondNumber=number_slider_7)  # -> SmallerThan, OrEqualTo
dispatch = Dispatch(List=ln, DispatchPattern=smaller.SmallerThan)  # -> ListA, ListB
line_4 = Line(dispatch.ListA)
line_5 = Line(dispatch.ListB)
len_2 = Length(Curve=line_5)
preview = CustomPreview(Geometry=line_4, Material=ColourSwatch(SwatchColor=RGB(114, 252, 127)))
preview_2 = CustomPreview(Geometry=line_5, Material=ColourSwatch(SwatchColor=RGB(252, 165, 114)))
